# Dynamo graph 01. HOLA MUNDO.dyn "1. HOLA MUNDO" (Dynamo 3.6.2.11575)

X = DoubleInput(0)
Y = DoubleInput(0)
Z = DoubleInput(1)
byCoordinates = Point.ByCoordinates(x=X, y=Y, z=Z)
VAR_RADIO = DoubleSlider(3, range=1..10 step 1)
byCenterPointRadius = Circle.ByCenterPointRadius(centerPoint=byCoordinates, radius=VAR_RADIO)
