# Dynamo graph 03. CLASE 1.dyn "CLASE 1" (Dynamo 3.6.2.11575)

# group: 1. NUDOS
number = DoubleInput(5)
number_slider = DoubleSlider(4.9, range=1..10 step 0.1)
number_slider_2 = DoubleSlider(5.3, range=1..10 step 0.1)
byCoordinates = Point.ByCoordinates(x=number, y=number_slider, z=number_slider_2)
watch = Watch(byCoordinates)

# group: 2. TIPOS DE DATOS
number_2 = DoubleInput(2)
watch_2 = Watch(number_2)
integer_slider = IntegerSlider(100, range=0..100 step 2)
watch_3 = Watch(integer_slider)
number_slider_3 = DoubleSlider(100, range=0..100 step 2)
watch_4 = Watch(number_slider_3)
string = StringInput("Hola Dynamo")
watch_5 = Watch(string)
boolean = BoolSelector(true)
watch_6 = Watch(boolean)
code_block = CodeBlock { 2; }
watch_7 = Watch(code_block)
code_block_2 = CodeBlock { 5.6; }
watch_8 = Watch(code_block_2)
code_block_3 = CodeBlock { "Hola Dynamo"; }
watch_9 = Watch(code_block_3)

# group: 3. MANEJO DE OPERADORES
code_block_4 = CodeBlock { 15; }
number_slider_4 = DoubleSlider(7.1, range=0..15 step 0.1)
add = code_block_4 + number_slider_4
watch_10 = Watch(add)
code_block_5 = CodeBlock { 15; }
number_slider_5 = DoubleSlider(4.6, range=0..15 step 0.1)
mul = code_block_5 * number_slider_5
watch_11 = Watch(mul)
code_block_6 = CodeBlock { "PLANO N° "; }
integer_slider_2 = IntegerSlider(71, range=1..100 step 1)
add_2 = code_block_6 + integer_slider_2
watch_12 = Watch(add_2)
code_block_7 = CodeBlock { 10; }
number_slider_6 = DoubleSlider(10, range=0..15 step 0.1)
eq = code_block_7 == number_slider_6
watch_13 = Watch(eq)

# group: 4. MANEJO DE STRINGS
string_2 = StringInput("ME LLAMO ")
code_block_8 = CodeBlock { "JUAN "; }
code_block_9 = CodeBlock { "FUENTES"; }
concat = String.Concat(string0=string_2, string1=code_block_8, string2=code_block_9)
watch_14 = Watch(concat)
code_block_10 = CodeBlock { "JUAN PABLO"; }
length = String.Length(string=code_block_10)
code_block_11 = CodeBlock { "ME LLAMO JUAN PABLO"; }
code_block_12 = CodeBlock { "JUAN PABLO"; }
code_block_13 = CodeBlock { "PEDRO"; }
replace = String.Replace(string=code_block_11, searchFor=code_block_12, replaceWith=code_block_13)
code_block_14 = CodeBlock { "ME LLAMO JUAN PABLO"; }
code_block_15 = CodeBlock { " "; }
split = String.Split(string=code_block_14, separator0=code_block_15)
code_block_16 = CodeBlock { "juan pablo"; }
toUpper = String.ToUpper(string=code_block_16)

# group: 5.1 PROCESO ESTATICO
coor_x = CodeBlock { 3; }
coor_y = CodeBlock { 3; }
coor_z = CodeBlock { 3; }
byCoordinates_2 = Point.ByCoordinates(x=coor_x, y=coor_y, z=coor_z)
RADIO = CodeBlock { 0.2; }
byCenterPointRadius = Circle.ByCenterPointRadius(centerPoint=byCoordinates_2, radius=RADIO)

# group: 5.2 PROCESO PARAMETRIZADO
number_slider_7 = DoubleSlider(4.2, range=0..10 step 0.1)
number_slider_8 = DoubleSlider(5.8, range=0..10 step 0.1)
number_slider_9 = DoubleSlider(3.6, range=0..10 step 0.1)
byCoordinates_3 = Point.ByCoordinates(x=number_slider_7, y=number_slider_8, z=number_slider_9)
number_slider_10 = DoubleSlider(0.5, range=0..2 step 0.1)
byCenterPointRadius_2 = Circle.ByCenterPointRadius(centerPoint=byCoordinates_3, radius=number_slider_10)
