# Dynamo graph 01. ESTRUCTURA_BASICA_LISTAS.dyn (Dynamo 3.6.2.11575)

# group: 1. LISTA USANDO CODE BLOCK
# .
code_block = CodeBlock { [1,2,3,4,5,6]; }
watch = Watch(code_block)
code_block_2 = CodeBlock { 0..1..#10; }
watch_2 = Watch(code_block_2)
code_block_3 = CodeBlock { 0..10..2; }
watch_3 = Watch(code_block_3)
code_block_4 = CodeBlock { 0..10; }
watch_4 = Watch(code_block_4)

# group: 2. CONTAR ELEMENTOS DE UNA LISTA
# .
code_block_5 = CodeBlock { [1,2,3,4,5,6]; }
count = List.Count(list=code_block_5)
watch_5 = Watch(count)

# group: 3. EXTRAER ELEMENTOS DE UNA LISTA
# .
number = DoubleInput(0)
number_2 = DoubleInput(50)
number_3 = DoubleInput(2)
range = Range(start=number, end=number_2, step=number_3)
integer_slider = IntegerSlider(10, range=0..10 step 1)
getItemAtIndex = List.GetItemAtIndex(list=range, index=integer_slider)
watch_6 = Watch(getItemAtIndex)

# group: 4. INVERTIR UNA LISTA
# .
number_4 = DoubleInput(0)
number_5 = DoubleInput(10)
number_6 = DoubleInput(2)
range_2 = Range(start=number_4, end=number_5, step=number_6)
reverse = List.Reverse(list=range_2)
watch_7 = Watch(reverse)

# group: 5. DESPLAZAMIENTO DE UNA LISTA
# .
number_7 = DoubleInput(0)
number_8 = DoubleInput(10)
number_9 = DoubleInput(2)
range_3 = Range(start=number_7, end=number_8, step=number_9)
code_block_6 = CodeBlock { 3; }
shiftIndices = List.ShiftIndices(list=range_3, amount=code_block_6)
watch_8 = Watch(shiftIndices)

# group: 6. FILTRADO DE CONTROL
# .
code_block_7 = CodeBlock { [0,1,2,3,4,5,6,7]; }
code_block_8 = CodeBlock { 4; }
mod = code_block_7 % code_block_8
code_block_9 = CodeBlock { 0; }
eq = mod == code_block_9
filterByBoolMask = List.FilterByBoolMask(list=eq, mask=eq)
watch_9 = Watch(filterByBoolMask.in)
watch_10 = Watch(filterByBoolMask.out)
