# Dynamo graph 02. LACING.dyn (Dynamo 3.6.2.11575)

# group: 1. SHORTEST
code_block = CodeBlock { 0..5..1; }
code_block_2 = CodeBlock { 0; }
code_block_3 = CodeBlock { 0; }
byCoordinates = Point.ByCoordinates(x=code_block, y=code_block_2, z=code_block_3)
code_block_4 = CodeBlock { 0..10..1; }
code_block_5 = CodeBlock { 0; }
code_block_6 = CodeBlock { 5; }
byCoordinates_2 = Point.ByCoordinates(x=code_block_4, y=code_block_5, z=code_block_6)
byStartPointEndPoint = Line.ByStartPointEndPoint(startPoint=byCoordinates, endPoint=byCoordinates_2, lacing=Shortest)
watch_3d = Watch3D(byStartPointEndPoint)

# group: 2. LONGEST
code_block_7 = CodeBlock { 0..5..1; }
code_block_8 = CodeBlock { 0; }
code_block_9 = CodeBlock { 0; }
byCoordinates_3 = Point.ByCoordinates(x=code_block_7, y=code_block_8, z=code_block_9)
code_block_10 = CodeBlock { 0..10..1; }
code_block_11 = CodeBlock { 0; }
code_block_12 = CodeBlock { 5; }
byCoordinates_4 = Point.ByCoordinates(x=code_block_10, y=code_block_11, z=code_block_12)
byStartPointEndPoint_2 = Line.ByStartPointEndPoint(startPoint=byCoordinates_3, endPoint=byCoordinates_4, lacing=Longest)
watch_3d_2 = Watch3D(byStartPointEndPoint_2)

# group: 3. CROSS PRODUCT
code_block_13 = CodeBlock { 0..5..1; }
code_block_14 = CodeBlock { 0; }
code_block_15 = CodeBlock { 0; }
byCoordinates_5 = Point.ByCoordinates(x=code_block_13, y=code_block_14, z=code_block_15)
code_block_16 = CodeBlock { 0..10..1; }
code_block_17 = CodeBlock { 0; }
code_block_18 = CodeBlock { 5; }
byCoordinates_6 = Point.ByCoordinates(x=code_block_16, y=code_block_17, z=code_block_18)
byStartPointEndPoint_3 = Line.ByStartPointEndPoint(startPoint=byCoordinates_5, endPoint=byCoordinates_6, lacing=CrossProduct)
watch_3d_3 = Watch3D(byStartPointEndPoint_3)
