# Dynamo graph 03. LISTAS_DE_LISTAS.dyn (Dynamo 3.6.2.11575)

# group: 1. UNION DE DOS LISTAS
code_block = CodeBlock { 0..5..1; }
code_block_2 = CodeBlock { 0..5..1; }
list_create = List.Create(item0=code_block, item1=code_block_2)
watch = Watch(list_create)
flatten = List.Flatten(list=list_create)
watch_2 = Watch(flatten)

# group: SIN FLATTEN
code_block_3 = CodeBlock { 0..5..1; }
code_block_4 = CodeBlock { 0..5..1; }
code_block_5 = CodeBlock { 0; }
byCoordinates = Point.ByCoordinates(x=code_block_3, y=code_block_4, z=code_block_5)
code_block_6 = CodeBlock { 0..5..1; }
code_block_7 = CodeBlock { 0..5..1; }
code_block_8 = CodeBlock { 5; }
byCoordinates_2 = Point.ByCoordinates(x=code_block_6, y=code_block_7, z=code_block_8)
list_create_2 = List.Create(item0=byCoordinates, item1=byCoordinates_2)
byPoints = PolyCurve.ByPoints(points=list_create_2)
watch_3d = Watch3D(byPoints)

# group: 2. FLATTEN Y SORT
code_block_9 = CodeBlock { 2..8..2; }
code_block_10 = CodeBlock { 1..7..2; }
list_create_3 = List.Create(item0=code_block_9, item1=code_block_10)
flatten_2 = List.Flatten(list=list_create_3)
sort = List.Sort(list=flatten_2)

# group: CON FLATTEN
code_block_11 = CodeBlock { 0..5..1; }
code_block_12 = CodeBlock { 0..5..1; }
code_block_13 = CodeBlock { 0; }
byCoordinates_3 = Point.ByCoordinates(x=code_block_11, y=code_block_12, z=code_block_13)
code_block_14 = CodeBlock { 0..5..1; }
code_block_15 = CodeBlock { 0..5..1; }
code_block_16 = CodeBlock { 5; }
byCoordinates_4 = Point.ByCoordinates(x=code_block_14, y=code_block_15, z=code_block_16)
list_create_4 = List.Create(item0=byCoordinates_3, item1=byCoordinates_4)
flatten_3 = List.Flatten(list=list_create_4)
byPoints_2 = PolyCurve.ByPoints(points=flatten_3)
watch_3d_2 = Watch3D(byPoints_2)

# group: 3. CHOP
code_block_17 = CodeBlock { [1,2,3,4,5,6,7,8]; }
code_block_18 = CodeBlock { 2; }
chop = List.Chop(list=code_block_17, lengths=code_block_18)

# group: 4. LIST.COMBINE
add = _ + _  # unwired: x, y
code_block_19 = CodeBlock { 2..8..2; }
code_block_20 = CodeBlock { 1..7..2; }
combine = List.Combine(combineFunction=add, list0=code_block_19, list1=code_block_20)

# group: 5. LIST.MAP
code_block_21 = CodeBlock { [10,20,30,40]; }
code_block_22 = CodeBlock { 2; }
mul = _ * code_block_22  # unwired: x
map = List.Map(list=code_block_21, function=mul)

# group: 6.FILTRADO
code_block_23 = CodeBlock { 0..9..1; }
byCoordinates_5 = Point.ByCoordinates(x=code_block_23, y=code_block_23, lacing=CrossProduct)
code_block_24 = CodeBlock { 0.25; }
byCenterPointRadius = Circle.ByCenterPointRadius(centerPoint=byCoordinates_5@L2, radius=code_block_24)
integer_slider = IntegerSlider(0, range=0..9 step 1)
getItemAtIndex = List.GetItemAtIndex(list=byCenterPointRadius@L2, index=integer_slider)
watch_3d_3 = Watch3D(getItemAtIndex)

# group: 7. TRASPUESTA
code_block_25 = CodeBlock { 0..10..1; }
# note: 1 LISTA CON 11 ELEMENTOS
list_create_5 = List.Create(item0=code_block_25)
# note: 11 LISTAS CON 1 ELEMENTO
transpose = List.Transpose(lists=list_create_5)
