# Dynamo graph 04. EJEMPLO.dyn "04." (Dynamo 3.6.2.11575)

structural_column_types = StructuralColumnTypes(index=0)
code_block = CodeBlock { 0..40..#6; }
code_block_2 = CodeBlock { 0; }
byCoordinates = Point.ByCoordinates(x=code_block, y=code_block_2)
levels = Levels("00. PLANTA BAJA N+0.00")
byPointAndLevel = FamilyInstance.ByPointAndLevel(familyType=structural_column_types, point=byCoordinates, level=levels)
code_block_3 = CodeBlock { "Mark"; }
count = List.Count(list=byCoordinates)
code_block_4 = CodeBlock(n=count) { 0..(n-1); }
code_block_5 = CodeBlock(indices=code_block_4) { "C-"+indices; }
setParameterByName = Element.SetParameterByName(element=byPointAndLevel, parameterName=code_block_3, value=code_block_5)
