# Dynamo graph 01. VECTORES.dyn (Dynamo 3.6.2.11575)

# group: 1. CREACION DE UN VECTOR
number_slider = DoubleSlider(1, range=0..10 step 0.1)
number_slider_2 = DoubleSlider(5.2, range=0..10 step 0.1)
number_slider_3 = DoubleSlider(1.9, range=0..10 step 0.1)
byCoordinates = Vector.ByCoordinates(x=number_slider, y=number_slider_2, z=number_slider_3)

# group: 2. CREACION DE UN VECTOR CON DOS PUNTOS
number_slider_4 = DoubleSlider(1, range=0..10 step 0.1)
number_slider_5 = DoubleSlider(1, range=0..10 step 0.1)
number_slider_6 = DoubleSlider(1, range=0..10 step 0.1)
byCoordinates_2 = Point.ByCoordinates(x=number_slider_4, y=number_slider_5, z=number_slider_6)
number_slider_7 = DoubleSlider(5.7, range=0..10 step 0.1)
number_slider_8 = DoubleSlider(7.1, range=0..10 step 0.1)
number_slider_9 = DoubleSlider(4.5, range=0..10 step 0.1)
byCoordinates_3 = Point.ByCoordinates(x=number_slider_7, y=number_slider_8, z=number_slider_9)
byTwoPoints = Vector.ByTwoPoints(start=byCoordinates_2, end=byCoordinates_3)

# group: 3. NORMALIZACION Y ESCALA
number_slider_10 = DoubleSlider(1, range=0..10 step 0.1)
number_slider_11 = DoubleSlider(5.2, range=0..10 step 0.1)
number_slider_12 = DoubleSlider(1.9, range=0..10 step 0.1)
byCoordinates_4 = Vector.ByCoordinates(x=number_slider_10, y=number_slider_11, z=number_slider_12)
normalized = Vector.Normalized(vector=byCoordinates_4)
integer_slider = IntegerSlider(1, range=1..10 step 1)
scale = Vector.Scale(vector=normalized, scale_factor=integer_slider)

# group: 4. VECTOR CON UNA LINEA
byCoordinates_5 = Point.ByCoordinates()
number_slider_13 = DoubleSlider(-5.5, range=-10..10 step 0.1)
number_slider_14 = DoubleSlider(0.7, range=-10..10 step 0.1)
number_slider_15 = DoubleSlider(1.7, range=-10..10 step 0.1)
byCoordinates_6 = Point.ByCoordinates(x=number_slider_13, y=number_slider_14, z=number_slider_15)
byTwoPoints_2 = Vector.ByTwoPoints(start=byCoordinates_5, end=byCoordinates_6)
normalized_2 = Vector.Normalized(vector=byTwoPoints_2)
number_slider_16 = DoubleSlider(1, range=0..100 step 0.1)
byStartPointDirectionLength = Line.ByStartPointDirectionLength(startPoint=byCoordinates_5, direction=normalized_2, length=number_slider_16)
