# Dynamo graph 02. PLANOS.dyn (Dynamo 3.6.2.11575)

# group: 2. CREACION DE UN PLANO RELACIONADO CON UN VECTOR NORMAL
byCoordinates = Point.ByCoordinates()
number_slider = DoubleSlider(-2.3, range=-10..10 step 0.1)
number_slider_2 = DoubleSlider(3.4, range=-10..10 step 0.1)
number_slider_3 = DoubleSlider(1.7, range=-10..10 step 0.1)
byCoordinates_2 = Point.ByCoordinates(x=number_slider, y=number_slider_2, z=number_slider_3)
byTwoPoints = Vector.ByTwoPoints(start=byCoordinates, end=byCoordinates_2)
normalized = Vector.Normalized(vector=byTwoPoints)
byStartPointDirectionLength = Line.ByStartPointDirectionLength(startPoint=byCoordinates, direction=normalized)
byOriginNormal = Plane.ByOriginNormal(origin=byCoordinates, normal=normalized)
watch_3d = Watch3D(byOriginNormal)

# group: 1. CREACION DE UN PLANO RELACIONADO A UN SISTEMA DE COORDENADAS
byCoordinates_3 = Point.ByCoordinates()
ZAxis = Vector.ZAxis()
byOriginNormal_2 = Plane.ByOriginNormal(origin=byCoordinates_3, normal=ZAxis)
watch_3d_2 = Watch3D(byOriginNormal_2)
