# Dynamo graph 02. POINTS.dyn (Dynamo 3.6.2.11575)

# group: 1. PUNTO EN UN SISTEMA RECTANGULAR
number_slider = DoubleSlider(30.7, range=0..100 step 0.1)
number_slider_2 = DoubleSlider(27.5, range=0..100 step 0.1)
number_slider_3 = DoubleSlider(16.8, range=0..100 step 0.1)
byCoordinates = Point.ByCoordinates(x=number_slider, y=number_slider_2, z=number_slider_3)

# group: 2. PUNTO EN SISTEMA CILINDRICO Y ESFERICO
number_slider_4 = DoubleSlider(147.1, range=0..360 step 0.1)
number_slider_5 = DoubleSlider(1.4, range=0..10 step 0.1)
number_slider_6 = DoubleSlider(7.6, range=0..10 step 0.1)
byCylindricalCoordinates = Point.ByCylindricalCoordinates(angle=number_slider_4, elevation=number_slider_5, radius=number_slider_6)
number_slider_7 = DoubleSlider(0, range=0..360 step 0.1)
number_slider_8 = DoubleSlider(360, range=0..360 step 0.1)
number_slider_9 = DoubleSlider(1.5, range=0..10 step 0.1)
bySphericalCoordinates = Point.BySphericalCoordinates(phi=number_slider_7, theta=number_slider_8, radius=number_slider_9)

# group: 3. PUNTO EN REFERENCIA DE UN PLANO
code_block = CodeBlock()
# ---------- code_block.designscript (5 lines) ----------
P1=Point.ByCoordinates(0,0,0);
P2=Point.ByCoordinates(10,0,0);
P3=Point.ByCoordinates(10,5,6);
P4=Point.ByCoordinates(0,5,6);
[P1,P2,P3,P4];
# ----------------------------------------
byPerimeterPoints = Surface.ByPerimeterPoints(points=code_block.out4)
number_slider_10 = DoubleSlider(0.2, range=0..1 step 0.1)
number_slider_11 = DoubleSlider(0.8, range=0..1 step 0.1)
pointAtParameter = Surface.PointAtParameter(surface=byPerimeterPoints, u=number_slider_10, v=number_slider_11)
