# Dynamo graph 03. CURVAS.dyn (Dynamo 3.6.2.11575)

# group: 1. LINEA CON DOS PUNTOS
code_block = CodeBlock { p1=Point.ByCoordinates(0,0,0); }
code_block_2 = CodeBlock { p1=Point.ByCoordinates(5,7,9); }
byStartPointEndPoint = Line.ByStartPointEndPoint(startPoint=code_block, endPoint=code_block_2)
watch_3d = Watch3D(byStartPointEndPoint)

# group: 2. POLYLINEA
code_block_3 = CodeBlock()
# ---------- code_block_3.designscript (17 lines) ----------
p1 = Point.ByCoordinates(-1, 0, 0);
   // Base inferior izquierda;
p2 = Point.ByCoordinates(1, 0, 0);
    // Base inferior derecha;
p3 = Point.ByCoordinates(1, 4.5, 0);
   // Encuentro alma-ala derecho;
p4 = Point.ByCoordinates(2.0, 4.5, 0);
   // Extremo derecho del ala;
p5 = Point.ByCoordinates(2.0, 6.0, 0);
   // Esquina superior derecha;
p6 = Point.ByCoordinates(-2.0, 6.0, 0);
  // Esquina superior izquierda;
p7 = Point.ByCoordinates(-2.0, 4.5, 0);
  // Extremo izquierdo del ala;
p8 = Point.ByCoordinates(-1.0, 4.5, 0);
  // Encuentro alma-ala izquierdo;
[p1,p2,p3,p4,p5,p6,p7,p8];
# ----------------------------------------
boolean = BoolSelector(true)
byPoints = PolyCurve.ByPoints(points=code_block_3.out8, connectLastToFirst=boolean)
watch_3d_2 = Watch3D(byPoints)

# group: 4. CIRCULO
code_block_4 = CodeBlock { centro=Point.ByCoordinates(0, 0, 0); }
number_slider = DoubleSlider(2.6, range=0..5 step 0.1)
byCenterPointRadius = Circle.ByCenterPointRadius(centerPoint=code_block_4, radius=number_slider)
watch_3d_3 = Watch3D(byCenterPointRadius)  # unwired: arg1

# group: 3. ARCOS Y ARCO ELIPTICO
code_block_5 = CodeBlock { centro=Point.ByCoordinates(5, 5, 5); }
number_slider_2 = DoubleSlider(3.3, range=0..5 step 0.1)
number_slider_3 = DoubleSlider(234, range=0..360 step 1)
number_slider_4 = DoubleSlider(198, range=0..360 step 1)
byCenterPointRadiusAngle = Arc.ByCenterPointRadiusAngle(center=code_block_5, radius=number_slider_2, startAngle=number_slider_3, endAngle=number_slider_4)
watch_3d_4 = Watch3D(byCenterPointRadiusAngle)

# group: 5. ELIPSE
number = DoubleInput(3)
number_2 = DoubleInput(1)
byCoordinateSystemRadii = Ellipse.ByCoordinateSystemRadii(xAxisRadius=number, yAxisRadius=number_2)
watch_3d_5 = Watch3D(byCoordinateSystemRadii)

# group: 6. CURVAS NURBS
code_block_6 = CodeBlock()
# ---------- code_block_6.designscript (10 lines) ----------
// Generar puntos de una curva de seno con un Code Block:
periodos = 10;
// número de ondas completas;
resolucion = 100;
// cantidad de puntos (más = curva más suave);
//procedimiento
x = 0..(periodos*2*Math.PI)..#resolucion;
// dominio en radianes, para el eje X;
y = Math.Sin(x / Math.PI * 180);
// se convierte a grados solo para el cálculo;
# ----------------------------------------
byCoordinates = Point.ByCoordinates(x=code_block_6.x, y=code_block_6.y)
byControlPoints = NurbsCurve.ByControlPoints(points=byCoordinates)
watch_3d_6 = Watch3D(byControlPoints)  # graph output
code_block_7 = CodeBlock()  # same code as code_block_6
byCoordinates_2 = Point.ByCoordinates(x=code_block_7.x, y=code_block_7.y)
byPoints_2 = NurbsCurve.ByPoints(points=byCoordinates_2)
watch_3d_7 = Watch3D(byPoints_2)  # graph output

# group: 1. CREACION DE UN PLANO RELACIONADO A UN SISTEMA DE COORDENADAS
byCoordinates_3 = Point.ByCoordinates()
ZAxis = Vector.ZAxis()
byOriginNormal = Plane.ByOriginNormal(origin=byCoordinates_3, normal=ZAxis)
watch_3d_8 = Watch3D(byOriginNormal)

# group: 3. PUNTO EN REFERENCIA DE UN PLANO-PUNTO DE PARAMETRO
code_block_8 = CodeBlock()
# ---------- code_block_8.designscript (5 lines) ----------
P1=Point.ByCoordinates(0,0,0);
P2=Point.ByCoordinates(10,0,0);
P3=Point.ByCoordinates(10,5,6);
P4=Point.ByCoordinates(0,5,6);
[P1,P2,P3,P4];
# ----------------------------------------
byPerimeterPoints = Surface.ByPerimeterPoints(points=code_block_8.out4)
number_slider_5 = DoubleSlider(0.2, range=0..1 step 0.1)
number_slider_6 = DoubleSlider(0.6, range=0..1 step 0.1)
pointAtParameter = Surface.PointAtParameter(surface=byPerimeterPoints, u=number_slider_5, v=number_slider_6)
watch_3d_9 = Watch3D(byPerimeterPoints, pointAtParameter)

# group: 2. CREACION DE UN PLANO RELACIONADO CON UN VECTOR NORMAL
byCoordinates_4 = Point.ByCoordinates()
number_slider_7 = DoubleSlider(-2.3, range=-10..10 step 0.1)
number_slider_8 = DoubleSlider(3.4, range=-10..10 step 0.1)
number_slider_9 = DoubleSlider(1.7, range=-10..10 step 0.1)
byCoordinates_5 = Point.ByCoordinates(x=number_slider_7, y=number_slider_8, z=number_slider_9)
byTwoPoints = Vector.ByTwoPoints(start=byCoordinates_4, end=byCoordinates_5)
normalized = Vector.Normalized(vector=byTwoPoints)
byOriginNormal_2 = Plane.ByOriginNormal(origin=byCoordinates_4, normal=normalized)
watch_3d_10 = Watch3D(byOriginNormal_2)

# group: 4. PUNTO EN REFERENCIA DE UN PLANO-VECTOR DE PARAMETRO
code_block_9 = CodeBlock()  # same code as code_block_8
byPerimeterPoints_2 = Surface.ByPerimeterPoints(points=code_block_9.out4)
number_slider_10 = DoubleSlider(0.2, range=0..1 step 0.1)
number_slider_11 = DoubleSlider(0.6, range=0..1 step 0.1)
normalAtParameter = Surface.NormalAtParameter(surface=byPerimeterPoints_2, u=number_slider_10, v=number_slider_11)
watch_3d_11 = Watch3D(byPerimeterPoints_2, normalAtParameter)

# group: 5. PUNTO EN REFERENCIA DE UN PLANO-LINEA DE PARAMETRO
code_block_10 = CodeBlock()  # same code as code_block_8
byPerimeterPoints_3 = Surface.ByPerimeterPoints(points=code_block_10.out4)
number_slider_12 = DoubleSlider(1, range=0..1 step 1)
number_slider_13 = DoubleSlider(0.5, range=0..1 step 0.1)
getIsoline = Surface.GetIsoline(surface=byPerimeterPoints_3, isoDirection=number_slider_12, parameter=number_slider_13)
watch_3d_12 = Watch3D(byPerimeterPoints_3, getIsoline)

# group: 2. GENERACION DE UN CUBO
number_slider_14 = DoubleSlider(6.9, range=0..100 step 0.1)
number_slider_15 = DoubleSlider(8.5, range=0..100 step 0.1)
number_slider_16 = DoubleSlider(4.3, range=0..100 step 0.1)
byLengths = Cuboid.ByLengths(width=number_slider_14, length=number_slider_15, height=number_slider_16)
watch_3d_13 = Watch3D(byLengths)
volume = Solid.Volume(solid=watch_3d_13)

# group: 1. GENERACION DE UN CONO
number_slider_17 = DoubleSlider(0, range=0..100 step 0.1)
number_slider_18 = DoubleSlider(0, range=0..100 step 0.1)
number_slider_19 = DoubleSlider(4.3, range=0..100 step 0.1)
byCoordinates_6 = Point.ByCoordinates(x=number_slider_17, y=number_slider_18, z=number_slider_19)
number_slider_20 = DoubleSlider(1.3, range=0..100 step 0.1)
byPointsRadius = Cone.ByPointsRadius(endPoint=byCoordinates_6, startRadius=number_slider_20)
watch_3d_14 = Watch3D(byPointsRadius)
volume_2 = Solid.Volume(solid=watch_3d_14)

# group: 3. UNION DE DOS SOLIDOS
union = Solid.Union(solid=watch_3d_14, solid_2=watch_3d_13)
watch_3d_15 = Watch3D(union)
volume_3 = Solid.Volume(solid=watch_3d_15)

# group: 4. SUSTRACCION DE DOS SOLIDOS
byUnion = Solid.ByUnion(solids=watch_3d_13)
difference = Solid.Difference(solid=watch_3d_14, other=byUnion)
watch_3d_16 = Watch3D(difference)
volume_4 = Solid.Volume(solid=watch_3d_16)

# group: 1. MALLADO DE SOLIDO
code_block_11 = CodeBlock { 10; }
code_block_12 = CodeBlock { 10; }
boolean_2 = BoolSelector(false)
sphere = Mesh.Sphere(radius=code_block_11, divisions=code_block_12, icosphere=boolean_2)
watch_3d_17 = Watch3D(sphere)
byCoordinates_7 = Point.ByCoordinates()
byCenterPointRadius_2 = Sphere.ByCenterPointRadius(centerPoint=byCoordinates_7, radius=code_block_11)
watch_3d_18 = Watch3D(byCenterPointRadius_2)
